# Grasshopper definition k_rooms_cluster.gh (Grasshopper 1.0.7)

# ---- group: core
point = Point([Point(99.73913902, 7.790399127, 0), Point(102.1266606, 1.691035164, 0), Point(104.7340223, 2.711655072, 0), Point(102.3465007, 8.811019035, 0)])
point_2 = Point([Point(100.4317025, 6.021117977, 0), Point(100.9420125, 4.71743713, 0), Point(103.5493742, 5.738057038, 0), Point(103.0390642, 7.041737885, 0)])
polyline = PolyLine(Vertices=point, Closed=True)
polyline_2 = PolyLine(Vertices=point_2, Closed=True)

# ----
point_3 = Point([Point(87.78853375, 12.94273039, 0), Point(93.51272956, -1.680782989, 0), Point(113.3479533, 6.083473225, 0), Point(109.4102002, 16.14318934, 0)])
polyline_3 = PolyLine(Vertices=point_3, Closed=True)
ghpython_script = GhPythonScript(core=polyline, hall=polyline_2, floor=polyline_3)  # -> out, a; inputs core: Curve, hall: Curve, floor: Curve
# ---------- ghpython_script: Python ----------
from utils.kmeans.kmeans import KMeans
from utils.utils import LineHelper
import Rhino.Geometry as rg

class KRoomsCluster(KMeans, LineHelper):
    """
    To use the kmeans module, refer the link below.
    https://github.com/PARKCHEOLHEE-lab/GhPythonUtils
    """
    
    def __init__(self, floor, core, hall, target_area, axis=None):
        self.floor = floor
        self.core = core
        self.hall = hall
        self.target_area = target_area
        self.axis = axis
        
        KMeans.__init__(self)
        LineHelper.__init__(self)
        
        self.predict()
        
    def predict(self):
        self._gen_axis_segment()
        self._gen_given_axis_aligned_obb()
        
    def _gen_given_axis_aligned_obb(self):
        self.obb = self.get_2d_obb_from_line(self.axis, self.floor)
        
    def _gen_axis_segment(self):
        if self.axis is None:
            self.axis = self.hall.DuplicateSegments()[0]
        
    def _get_longest_segment_axis_grid(self):
        return
        
    def _get_estimated_k(self):
        """The K is given floor area divided target area."""
        k = 0
        return k
        
    def _get_shortest_path(self):
        return

if __name__ == "__main__":
    krooms = KRoomsCluster(
        floor=floor,
        core=core,
        hall=hall,
        target_area=None,
    )

    a = [krooms.axis, krooms.obb]
# ---------- end ghpython_script ----------
